# Grasshopper definition AdSecGH_Example1_RectangularBeam.gh (Grasshopper 1.0.7)
# Copyright: Arup
# plug-ins: AdSec

material = StandardMaterial(Material_Type="Rebar", Design_Code="EN1992", National_Annex="GB", Edition="Edition_2014", Grade="S500B")

# ---- group: Main profile
xy = XYPlane(Origin=Point(0, 0, 0))
profile = CreateProfile(
    Depth_mm=Slider(600, range=0..1000),
    Width_mm=Slider(300, range=0..1000),
    LocalPlane=xy,
    NumberOfInputs=2,
    catalogueIndex=-1,
    inclSS=False,
    lengthUnit="Millimeter",
    mode="Other",
    Profile_type="Rectangle",
    Measure="Millimeter",
    typeIndex=-1)

# ---- group: Sides
rebar = CreateRebar(Material=material, Diameter_mm=Slider(16, range=0..100), mode="Single", Rebar_Type="Single", Measure="Millimeter")
spacing = CreateRebarSpacing(Rebar=rebar, Spacing_mm=Slider(200, range=0..1000), mode="Distance", Spacing_method="Distance", Measure="Millimeter")

# ---- group: Bottom
rebar_2 = CreateRebar(Material=material, Diameter_mm=Slider(25, range=0..100), mode="Single", Rebar_Type="Single", Measure="Millimeter")
spacing_2 = CreateRebarSpacing(Rebar=rebar_2, Count=Slider(4, range=0..10), mode="Count", Spacing_method="Count")

# ----
material_2 = StandardMaterial(Material_Type="Concrete", Design_Code="EN1992", National_Annex="GB", Edition="Edition_2014", Grade="C30_37")

# ---- group: Top
rebar_3 = CreateRebar(Material=material, Diameter_mm=Slider(16, range=0..100), mode="Single", Rebar_Type="Single", Measure="Millimeter")
spacing_3 = CreateRebarSpacing(Rebar=rebar_3, Count=Slider(4, range=0..10), mode="Count", Spacing_method="Count")

# ----
number_slider = Slider(30, range=0..100)

# ---- group: Links
rebar_4 = CreateRebar(Material=material, Diameter_mm=Slider(10, range=0..100), mode="Single", Rebar_Type="Single", Measure="Millimeter")
reinforcement_group = CreateReinforcementGroup(Rebar=rebar_4, Cover_mm=number_slider, Group_Type="Link", Measure="Millimeter")

# ----
reinforcement_group_2 = CreateReinforcementGroup(
    TopRebars=spacing_3,
    LeftSideRebars=spacing,
    RightSideRebars=spacing,
    BottomRebars=spacing_2,
    Cover_mm=number_slider,
    Group_Type="Template",
    Measure="Millimeter")
rbg = RebarGroup(flatten([reinforcement_group_2, reinforcement_group]))

# ---- group: Create Section
section = Section(Profile=profile, Material=material_2, RebarGroup=rbg)

# ----
section_2 = Section(Section=section)  # -> Section, Profile, Material, DesignCode, RebarGroup, SubComponent, SectionCurves

# ---- group: Analyse solution
analyse = AnalyseSection(Section=section)  # -> Results, FailureSurface

# ----
profileedit = EditProfile(Profile=section_2.Profile, Measure="Radian")
neg = Negative(Value=Slider(200, range=0..10000))

# ---- group: Bake these guys
crv = Curve(section_2.SectionCurves)

# ---- group: Top right corner point
vertex_point = CreateVertexPoint(Y_mm=Slider(150, range=0..1000), Z_mm=Slider(-300, range=-500..0), Measure="Millimeter")

# ----
load = CreateLoad(
    Myy_kN_m=Slider(64, range=0..100),
    Mzz_kN_m=Slider(10, range=0..100),
    Force_Unit="Kilonewton",
    Moment_Unit="KilonewtonMeter")
load_2 = CreateLoad(
    Fx_kN=neg,
    Myy_kN_m=Slider(55, range=0..100),
    Mzz_kN_m=Slider(11, range=0..100),
    Force_Unit="Kilonewton",
    Moment_Unit="KilonewtonMeter")
lng = ListLength(List=crv)

# ---- group: CadTest
int = Integer(lng)

# ----
sls = ServiceabilityResult(Results=analyse.Results, Load=load)  # -> Load, Cracks, MaximumCrack, CrackUtil, Deformation, SecantStiffness, UncrackedMomentRanges
uls = StrengthResult(Results=analyse.Results, Load=load_2)  # -> Load, LoadUtil, Deformation, DeformationUtil, MomentRanges, NeutralAxis

# ---- group: Rebar stress for all bars
rss = RebarStressStrain(Results=analyse.Results, Load=load_2)  # -> Position_mm, ULSStrain, ULSStress, SLSStrain, SLSStress

# ---- group: Concrete stress at YZ point
css = ConcreteStressStrain(Results=analyse.Results, Load=load_2, VertexPoint=vertex_point)  # -> ULSStrain_, ULSStress_MPa, SLSStrain_, SLSStress_MPa

# ----
panel = Panel(rss.Position_mm)
panel_2 = Panel(rss.ULSStrain)
panel_3 = Panel(uls.LoadUtil)
panel_4 = Panel(sls.Cracks)
panel_5 = Panel([css.ULSStrain_, css.ULSStress_MPa, css.SLSStrain_, css.SLSStress_MPa])

# ---- group: Neutral line
line = Line(uls.NeutralAxis)

# ----
panel_6 = Panel(sls.CrackUtil)
pt = ConstructPoint(XCoordinate="500", YCoordinate=0, ZCoordinate=0)
rad = Radians(Degrees=Slider(-170, range=-190..90))
rectangle = Rectangle(Plane=pt, XSize=Slider(500, range=0..1000), YSize=Slider(605, range=0..1000), Radius=0)  # -> Rectangle, Length

# ---- group: CrackUtilisationTest
num = Number(sls.CrackUtil)

# ---- group: LoadUtilisationTest
num_2 = Number(uls.LoadUtil)

# ---- group: ConcreteStressTest
num_3 = Number([css.ULSStrain_, css.ULSStress_MPa, css.SLSStrain_, css.SLSStress_MPa])

# ----
n_m_diagram = NMDiagram(
    Results=analyse.Results,
    MomentAngle_rad=rad,
    Plot=rectangle.Rectangle,
    angle="Radian",
    force="Meganewton",
    Interaction="N-M",
    Measure="Radian")

# ---- group: RebarUlsStrainTest
num_4 = Number(rss.ULSStrain)

# ---- group: RebarUlsStressTest
num_5 = Number(rss.ULSStress)

# ---- group: RebarSlsStrainTest
num_6 = Number(rss.SLSStrain)

# ---- group: RebarSlsStressTest
num_7 = Number(rss.SLSStress)

# ----
crv_2 = Curve(n_m_diagram)
boundary = BoundarySurfaces(Edges=crv_2)
area = Area(Geometry=boundary)  # -> Area, Centroid

# ---- group: NmDiagramTest
num_8 = Number(area.Area)
